# Dynamo graph ChangeSysPath.dyn (Dynamo 2.13.1.3887)

string = StringInput("ChangeSysPath.py")  # graph input
file_from_path = FileObject(path=string)
readText = FileSystem.ReadText(file=file_from_path)

# group: Reoad
reload = BoolSelector(true)

continue_ = BoolSelector(true)  # graph input
reverse = BoolSelector(false)  # graph input
select_model_element = DSModelElementSelection()  # nothing selected
python_script_from_string = PythonStringNode(script=readText, IN[0]=file_from_path, IN[1]=reload, IN[2]=continue_, IN[3]=reverse, IN[4]=select_model_element)  # IronPython2
string_2 = StringInput("Part1_CreatePointList.py")  # graph input; frozen
string_3 = StringInput("Part2_ChangeSysPath.py")  # graph input; frozen
string_4 = StringInput("Part3_CalculateTraysParameters.py")  # graph input; frozen
string_5 = StringInput("Part4_CheckHealth.py")  # graph input; frozen
code_block = CodeBlock { -84580; }
code_block_2 = CodeBlock { 710505; }
code_block_3 = CodeBlock { 0; }
byCoordinates = Point.ByCoordinates(x=code_block, y=code_block_2, z=code_block_3)
